vi "FGV.gvi"   [LabVIEW NXG 2.0.0]
inputs:
  "Reset": bool
outputs:
  "Numeric": i32
diagram:
  s1 = uninitialised  # shift register
  while {
    Increment(x=s1) -> w1
    Select(s=$Reset, t=0, f=w1) -> w2
    next s1 = w2
    stop if TRUE
  }
  $Numeric <- s1
