vi "Setup.gvi"   [LabVIEW NXG 2.0.0]
inputs:
  "channels": "channels.gtype"
  "Names": "Names.gtype"
outputs:
  "Task Out": string
  "error in": error
types:
  "channels.gtype" = string[]
  "Names.gtype" = string[]
uses:
  NI::DAQmx::Internal::DAQmx Create Task.gvi
  NI::DAQmx::Internal::DAQmx Create Channel (AI-Temperature-Thermocouple).gvi
  NI::DAQmx::Internal::DAQmx Timing (Sample Clock).gvi
diagram:
  disable {
    frame Enabled {
      w1 = default
    }
    frame Disabled {
      call "DAQmx Create Task.gvi"() -> (task out=w2, error out=w3)
      s1 = w2  # shift register
      s2 = w3  # shift register
      for {
        w4 = each element of $channels
        w5 = each element of $Names
        call "DAQmx Create Channel (AI-Temperature-Thermocouple).gvi"(task in=s1, error in=s2, physical channels=w4, name to assign=w5) -> (task out=w6, error out=w7)
        next s1 = w6
        next s2 = w7
      }
      call "DAQmx Timing (Sample Clock).gvi"(task in=s1, error in=s2, rate=100, sample mode="Continuous Samples"(10123)) -> (task out=w8, error out=w1)
    }
  }
  $"error in" <- w1
