vi "Annotate Graph.gvi"   [LabVIEW NXG 1.0.0]
inputs:
  "Graph": waveform<f64>[]
  "transposed array": f64[][]
outputs:
  "Extrapolation": waveform<f64>[]
diagram:
  for {
    w1 = each element of $"transposed array"
    w2 = each element of $Graph
    Property Node(instance in=w2) -> ("attributes"=w4)
    Property Node("Y"=w1, "attributes"=w4) -> (instance out=w5)
    append w5 to w3
  }
  $Extrapolation <- w3
