vi "IsOverLimit.gvi"   [LabVIEW NXG 1.0.0]
inputs:
  "Max": f64
  "Value": f64
outputs:
  "OverLimit?": bool
diagram:
  Is Greater Than 0(x=$Max) -> w1
  Is Less(x=$Max, y=$Value) -> w2
  Logical And(w1, w2) -> w3
  $"OverLimit?" <- w3
