vi "Process Data.gvi"   [LabVIEW NXG 2.0.0]
inputs:
  "Max Temps": f64[]
  "All Data In": waveform<f64>[]
  "New Sample Data": waveform<f64>[]
outputs:
  "All Data Out": waveform<f64>[]
  "Current Temp": f64[]
  "Data to log": waveform<f64>[]
uses:
  Analysis::IsOverLimit.gvi
diagram:
  for {
    w1 = each element of $"New Sample Data"
    w2 = each element of $"Max Temps"
    w3 = each element of $"All Data In"
    w4 = each element of $"New Sample Data"
    Property Node(instance in=w1) -> ("Y"=w8, "attributes"=w9)
    Array Index(array=w8) -> (out0[_]=w10)
    call "IsOverLimit.gvi"(Max=w2, Value=w10) -> (OverLimit?=w11)
    Set Waveform Attribute[WaveformDataType="Wfm(Double)"](name="FAIL", value=w11, waveform=w4) -> (waveform out=w12)
    Property Node(instance in=w3) -> ("Y"=w13, instance out=w14)
    Insert Into Array(inArray=w13, new=w10) -> w15
    Property Node(instance in=w14, "Y"=w15, "attributes"=w9) -> (instance out=w16)
    append w16 to w5
    append w12 to w6
    append w10 to w7
  }
  $"Current Temp" <- w7
  $"Data to log" <- w6
  $"All Data Out" <- w5
