vi "Open Config.gvi"   [LabVIEW NXG 2.0.0]
inputs:
  "configuration file": path = path "C:\\Users\\NXG-2\\Documents\\LabVIEW Projects\\Temperature_Test\\Test Configs\\PCB_Parts.ini"  # configuration file path is the path to the platform-independent configuration file.
outputs:
  "PCB Configuration Data": string[][]
  "Ref Des": string[]
  "Array_2": f64[]
  "Max Temp": string[]
  "Channels": "channels.gtype"
  "Names": "Names.gtype"
  "Array": waveform<f64>[]
types:
  "Names.gtype" = string[]
  "channels.gtype" = string[]
uses:
  NI::G Core::File IO (General)::Read Delimited Spreadsheet (string).gvi
diagram:
  call "Read Delimited Spreadsheet (string).gvi"(file=$"configuration file") -> (all rows=w1)
  $"PCB Configuration Data" <- w1
  Transpose 2D Array(2D array=w1) -> (transposed array=w2)
  Array Index(array=w2) -> (out0[_, _]=w3, out1[_, _]=w4, out2[_, _]=w5)
  Array Size(array=w3) -> (size(s)=w6)
  Initialize Array(element=waveform<f64> {dt=1, Y=[]}, size=w6) -> w7
  $Array <- w7
  $Channels <- w3
  $"Ref Des" <- w4
  $Names <- w4
  $"Max Temp" <- w5
  Floating Point String To Number(string=w5) -> (number=w8)
  $Array_2 <- w8
