vi "Create Unique Filename.gvi"   [LabVIEW NXG 1.0.0]
inputs:
  "Path_2": path
outputs:
  "Path": path
uses:
  NI::G Core::File IO (General)::Check if File or Folder Exists.gvi
diagram:
  while (iteration -> i1) {
    Strip Path(path=$Path_2) -> (name=w1, stripped path=w2)
    Number To Decimal String(number=i1) -> (decimal integer string=w3)
    Match Pattern(regular expression=".csv", string=w1) -> (before substring=w4)
    Concatenate Strings(w4, "_", w3, ".csv") -> w5
    Build Path(base path=w2, name or relative path=w5) -> (appended path=w6)
    call "Check if File or Folder Exists.gvi"(file or folder=w6) -> (file or folder exists?=w7)
    continue if w7
  }
  $Path <- w6
