vi "DUT Temp Check.gvi"   [LabVIEW NXG 2.0.0]
inputs:
  "Temp In (C)": f64
outputs:
  "Temperature Out": f64
  "Pass": bool
panel indicators:
  "Progress Bar": f64
  "Radial Progress Bar": f64
diagram:
  w1 = 40.5  # Threshold
  Is Less(x=$"Temp In (C)", y=w1) -> w2
  $Pass <- w2
  for (N = 100) (iteration -> i1) {
    Wait Until Next Multiple(multiple to wait=40)
    Increment(x=i1) -> w3
    $"Radial Progress Bar" <- w3
    $"Progress Bar" <- w3
  }
