vi "TempTester - old.gvi"   [LabVIEW NXG 2.0.0]
panel controls:
  "Configuration File": path = path "C:\\Users\\NXG-2\\Documents\\GitHub\\Keynote-HAL\\Keynote Demo SD and Libs\\Test Configs\\PCB_Parts_2.ini"  # configuration file path is the path to the platform-independent configuration file.
  "x button": bool
  "Log File": path = path "C:\\Users\\NXG-1\\Desktop\\Temperature_Test_ViD\\Log Files\\Logged_Data.csv"
  "Current Temp": f64[]
  "Extrapolated Ambient Temperature": f64
  "Tab": i32 = 1
  "Start": bool
  "TempData": f64[]
  "Extrapolate Data": bool
panel indicators:
  "PCB Configuration Data": string[][]
  "Graph": waveform<f64>[]
  "Index of ambient": i32
  "Extrapolation": waveform<f64>[]
  "Graph_2": waveform<f64>[]
  "Progress Bar": f64
  "Data Grid_2": "AnalysisDataGrid.gtype"
types:
  T1 = cluster{"Channel": string, "Ref Des": string, "Max Temp": f64, "Extrapolated Temp": f64, "Failure?": bool}
  "AnalysisDataGrid.gtype" = T1[]
uses:
  NI::G Core::File IO (General)::Read Delimited Spreadsheet (string).gvi
  DAQ::Setup.gvi
  DAQ::Start.gvi
  Logging::Log File Setup.gvi
  DAQ::Read.gvi
  Analysis::Process Data.gvi
  Logging::Log to File.gvi
  DAQ::Stop.gvi
  DAQ::Clear.gvi
  NI::G Core::Error::Display Error.gvi
  Analysis::Annotate Graph.gvi
  Analysis::IsOverLimit.gvi
diagram:
  call "Read Delimited Spreadsheet (string).gvi"(file=$"Configuration File") -> (all rows=w1)
  $"PCB Configuration Data" <- w1
  $Tab <- 1
  case (FALSE) {
    frame False, Default {
      # Skip Init Progress Bar
      w2 = 1
    }
    frame True {
      # Initialize
      for (N = 100) (iteration -> i1) {
        Wait Until Next Multiple(multiple to wait=25)
        Increment(x=i1) -> w3
        $"Progress Bar" <- w3
      }
      w2 = 1
    }
  }
  $Tab <- w2
  Transpose 2D Array(2D array=w1) -> (transposed array=w4)
  Array Index(array=w4) -> (out0[_, _]=w5, out1[_, _]=w6, out2[_, _]=w7)
  Floating Point String To Number(string=w7) -> (number=w8)
  call "Setup.gvi"(channels=w5, Names=w6) -> (Task Out=w9, error in=w10)
  call "Start.gvi"(Task In=w9, error in=w10) -> (Task Out=w11, Error=w12)
  call "Log File Setup.gvi"(Log File=$"Log File") -> (Path=w13)
  Array Size(array=w5) -> (size(s)=w14)
  Initialize Array(element=waveform<f64> {dt=1, Y=[]}, size=w14) -> w15
  s1 = w15  # shift register
  while {
    call "Read.gvi"(Task In=w11, Error In=w12) -> (Task Out=w16, Error=w17, Array=w18)
    call "Process Data.gvi"(Max Temps=w8, All Data In=s1, New Sample Data=w18) -> (All Data Out=w19, Current Temp=w20, Data to log=w21)
    $Graph <- w19
    $"Current Temp" <- w20
    call "Log to File.gvi"(Array=w21, Path=w13)
    w22 = $"x button"
    next s1 = w19
    stop if w22
  }
  call "Stop.gvi"(Task In=w16, error in=w17) -> (Task Out_2=w23, Error=w24)
  call "Clear.gvi"(Task In=w23, error in=w24) -> (Error=w25)
  call "Display Error.gvi"(error in=w25)
  while {
    w26 = $"Current Temp"
    Array Index(array=w26) -> (out0[$"Index of ambient"]=w27)
    To Lower Case(string=w6) -> w28
    To Lower Case(string="AMBIENT") -> w29
    Search 1D Array(1D array=w28, element=w29) -> (index of element=w30)
    Array Index(array=$"Current Temp") -> (out0[w30]=w31)
    Select(s=$"Extrapolate Data", t=$"Extrapolated Ambient Temperature", f=w31) -> w32
    Subtract(x=w32, y=w27) -> w33
    Add(w26, w33) -> w34
    $TempData <- w34
    for (N = w33) (iteration -> i2) {
      for {
        w36 = each element of w26
        Add(w36, i2) -> w38
        append w38 to w37
      }
      append w37 to w35
    }
    Array Size(array=w26) -> (size(s)=w39)
    Initialize Array(element=0, size=w27, size=w39) -> w40
    Insert Into Array(inArray=w40, new=w35) -> w41
    Transpose 2D Array(2D array=w41) -> (transposed array=w42)
    call "Annotate Graph.gvi"(Graph=$Graph, transposed array=w42) -> (Extrapolation=w43)
    $Extrapolation <- w43
    $"Index of ambient" <- w30
    w44 = $"x button"
    stop if w44
  }
  while {
    Array Index(array="AnalysisDataGrid.gtype" []) -> (out0[_]=w45)
    for {
      w46 = each element of w5
      w47 = each element of w6
      w48 = each element of w8
      w49 = each element of $TempData
      call "IsOverLimit.gvi"(Max=w48, Value=w49) -> (OverLimit?=w52)
      Property Node(instance in=w45, "Channel"=w46, "Ref Des"=w47, "Max Temp"=w48, "Extrapolated Temp"=w49, "Failure?"=w52) -> (instance out=w53)
      append w53 to w50
      append w52 to w51
    }
    $"Data Grid_2" <- w50
    Or Array Elements(Boolean array=w51)
    w54 = $"x button"
    stop if w54
  }
  sequence (after w22) (after w44) (after w54) {
    frame 0 {
      $"x button" <- FALSE
    }
  }
