vi "TempTester.gvi"   [LabVIEW NXG 2.0.0]
panel controls:
  "Configuration File": path = path "C:\\Users\\NXG-2\\Documents\\GitHub\\Keynote-HAL\\Keynote Demo SD and Libs\\Test Configs\\PCB_Parts_2.ini"  # configuration file path is the path to the platform-independent configuration file.
  "x button": bool
  "Log File": path = path "C:\\Users\\NXG-1\\Desktop\\Temperature_Test_ViD\\Log Files\\Logged_Data.csv"
  "Current Temp": f64[]
  "Extrapolated Ambient Temperature": f64 = 79.2452830189
  "Start": bool
  "TempData": f64[]
  "Extrapolate Data": bool
panel indicators:
  "PCB Configuration Data": string[][]
  "Graph": waveform<f64>[]
  "Index of ambient": i32
  "Extrapolation": waveform<f64>[]
  "Graph_2": waveform<f64>[]
  "Progress Bar": f64
  "Data Grid_2": "AnalysisDataGrid.gtype"
types:
  T1 = cluster{"Channel": string, "Ref Des": string, "Max Temp": f64, "Extrapolated Temp": f64, "Failure?": bool}
  "AnalysisDataGrid.gtype" = T1[]
uses:
  NI::G Core::File IO (General)::Read Delimited Spreadsheet (string).gvi
  DAQ::Setup.gvi
  DAQ::Start.gvi
  Logging::Log File Setup.gvi
  DAQ::Read.gvi
  Analysis::Process Data.gvi
  Logging::Log to File.gvi
  DAQ::Stop.gvi
  DAQ::Clear.gvi
  NI::G Core::Error::Display Error.gvi
  Analysis::Annotate Graph.gvi
  Analysis::IsOverLimit.gvi
diagram:
  call "Read Delimited Spreadsheet (string).gvi"(file=$"Configuration File") -> (all rows=w1)
  $"PCB Configuration Data" <- w1
  case (FALSE) {
    frame False, Default {
      # Skip Init Progress Bar
    }
    frame True {
      # Initialize
      for (N = 100) (iteration -> i1) {
        Wait Until Next Multiple(multiple to wait=25)
        Increment(x=i1) -> w2
        $"Progress Bar" <- w2
      }
    }
  }
  Transpose 2D Array(2D array=w1) -> (transposed array=w3)
  Array Index(array=w3) -> (out0[_, _]=w4, out1[_, _]=w5, out2[_, _]=w6)
  Floating Point String To Number(string=w6) -> (number=w7)
  call "Setup.gvi"(channels=w4, Names=w5) -> (Task Out=w8, error in=w9)
  call "Start.gvi"(Task In=w8, error in=w9) -> (Task Out=w10, Error=w11)
  call "Log File Setup.gvi"(Log File=$"Log File") -> (Path=w12)
  Array Size(array=w4) -> (size(s)=w13)
  Initialize Array(element=waveform<f64> {dt=1, Y=[]}, size=w13) -> w14
  s1 = w14  # shift register
  while {
    call "Read.gvi"(Task In=w10, Error In=w11) -> (Task Out=w15, Error=w16, Array=w17)
    call "Process Data.gvi"(Max Temps=w7, All Data In=s1, New Sample Data=w17) -> (All Data Out=w18, Current Temp=w19, Data to log=w20)
    $Graph <- w18
    $"Current Temp" <- w19
    call "Log to File.gvi"(Array=w20, Path=w12)
    w21 = $"x button"
    next s1 = w18
    stop if w21
  }
  call "Stop.gvi"(Task In=w15, error in=w16) -> (Task Out_2=w22, Error=w23)
  call "Clear.gvi"(Task In=w22, error in=w23) -> (Error=w24)
  call "Display Error.gvi"(error in=w24)
  while {
    w25 = $"Current Temp"
    Array Index(array=w25) -> (out0[$"Index of ambient"]=w26)
    To Lower Case(string=w5) -> w27
    To Lower Case(string="AMBIENT") -> w28
    Search 1D Array(1D array=w27, element=w28) -> (index of element=w29)
    Array Index(array=$"Current Temp") -> (out0[w29]=w30)
    Select(s=$"Extrapolate Data", t=$"Extrapolated Ambient Temperature", f=w30) -> w31
    Subtract(x=w31, y=w26) -> w32
    Add(w25, w32) -> w33
    $TempData <- w33
    for (N = w32) (iteration -> i2) {
      for {
        w35 = each element of w25
        Add(w35, i2) -> w37
        append w37 to w36
      }
      append w36 to w34
    }
    Array Size(array=w25) -> (size(s)=w38)
    Initialize Array(element=0, size=w26, size=w38) -> w39
    Insert Into Array(inArray=w39, new=w34) -> w40
    Transpose 2D Array(2D array=w40) -> (transposed array=w41)
    call "Annotate Graph.gvi"(Graph=$Graph, transposed array=w41) -> (Extrapolation=w42)
    $Extrapolation <- w42
    $"Index of ambient" <- w29
    w43 = $"x button"
    stop if w43
  }
  while {
    Array Index(array="AnalysisDataGrid.gtype" []) -> (out0[_]=w44)
    for {
      w45 = each element of w4
      w46 = each element of w5
      w47 = each element of w7
      w48 = each element of $TempData
      call "IsOverLimit.gvi"(Max=w47, Value=w48) -> (OverLimit?=w51)
      Property Node(instance in=w44, "Channel"=w45, "Ref Des"=w46, "Max Temp"=w47, "Extrapolated Temp"=w48, "Failure?"=w51) -> (instance out=w52)
      append w52 to w49
      append w51 to w50
    }
    $"Data Grid_2" <- w49
    Or Array Elements(Boolean array=w50)
    w53 = $"x button"
    stop if w53
  }
  sequence (after w21) (after w43) (after w53) {
    frame 0 {
      $"x button" <- FALSE
    }
  }
