vi "Test.gvi"   [LabVIEW NXG 1.0.0]
panel indicators:
  "Error Out": error
uses:
  Library::Msmt Prototype.gtype::Configure.gvi
  Library::Msmt Prototype.gtype::Acquire.gvi
  Library::Msmt Prototype.gtype::Measure.gvi
  Library::Msmt Prototype.gtype::Close.gvi
diagram:
  Build Array("FGEN.gtype" constant, "FGEN.gtype" constant) -> w1
  call "Configure.gvi"(Msmt In="Msmt Prototype.gtype" constant, Hardware Resources=w1) -> (Msmt Out=w2, Error Out=w3)
  call "Acquire.gvi"(Msmt In=w2, Error In=w3) -> (Msmt Out=w4, Error Out=w5)
  call "Measure.gvi"(Msmt In=w4, Error In=w5) -> (Msmt Out=w6, Error Out=w7)
  call "Close.gvi"(Msmt In=w6, Error In=w7) -> (Error Out=w8)
  $"Error Out" <- w8
