vi "Get Tag.gviweb"   [LabVIEW NXG 2.0.0]
inputs:
  "Host": string
outputs:
  "Array": f64[]
  "Array_2": f64[]
  "Observed Data and Fitted Curve": cluster{"Element 1": f64, "Element 2": f64}[][]
types:
  T1 = cluster{"X": f64[], "Y": f64[], "Best Gaussian Fit": f64[], "Upper Bound": f64[], "Lower Bound": f64[]}
uses:
  NI::HTTP::GET.gvi
diagram:
  Format Into String(formatString="http://%s:8080/hal/parametric-curve", $Host) -> w1
  call "GET.gvi"(url=w1) -> (body=w2)
  Unflatten From JSON(JSON string=w2, type and defaults=T1 {all zero or empty}) -> (value=w3)
  Property Node(instance in=w3) -> ("X"=w4, "Y"=w5, "Best Gaussian Fit"=w6, "Upper Bound"=w7, "Lower Bound"=w8)
  $Array <- w4
  Build Index And Bundle Cluster Array(w4, w5) -> (out=w9)
  Build Index And Bundle Cluster Array(w4, w6) -> (out=w10)
  Build Index And Bundle Cluster Array(w4, w7) -> (out=w11)
  Build Index And Bundle Cluster Array(w4, w8) -> (out=w12)
  Build Array(w9, w10, w11, w12) -> w13
  $"Observed Data and Fitted Curve" <- w13
  $Array_2 <- w7
  Array Size(array=w7)
