vi "Main.gviweb"   [LabVIEW NXG 2.0.0]
panel controls:
  "String": string
  "Previous test Results": i32 = -1
  "Select Test Site": i32 = "NIWeek Keynote Stage"(0)
panel indicators:
  "Observed Data and Fitted Curve": cluster{"Element 1": f64, "Element 2": f64}[][]
  "Sequence Pass/Fail": bool
  "Test Sequence Results": T1[]
types:
  T1 = cluster{"Bandwidth (MHz)": f64, "SNR": f64, "Power Consumption %": f64, "Step Pass?": bool}
  T2 = cluster{"X": f64[], "Y": f64[], "Best Gaussian Fit": f64[], "Upper Bound": f64[], "Lower Bound": f64[]}
uses:
  NI::HTTP::GET.gvi
diagram:
  while {
    Wait(time to wait=100)
    call "GET.gvi"(url="http://cirrostratus:8080/hal/parametric-curve") -> (body=w1)
    Unflatten From JSON(JSON string=w1, type and defaults=T2 {all zero or empty}) -> (value=w2)
    Property Node(instance in=w2) -> ("X"=w3, "Y"=w4, "Best Gaussian Fit"=w5, "Upper Bound"=w6, "Lower Bound"=w7)
    w8 = [TRUE, TRUE, TRUE, TRUE, TRUE, TRUE, TRUE, TRUE, FALSE, TRUE, TRUE, TRUE, FALSE]
    for (iteration -> i1) {
      w9 = each element of w8
      w10 = each element of w3
      w11 = each element of w6
      Increment(x=i1) -> w13
      Format Into String(formatString="Step %d", w13)
      Divide(x=w10, y=w11) -> w14
      w15 = T1 {"Bandwidth (MHz)"=0, "SNR"=0, "Power Consumption %"=1, "Step Pass?"=TRUE}
      Random Number() -> (number (0 to 1)=w16)
      Add(100, w16) -> w17
      Random Number() -> (number (0 to 1)=w18)
      Add(77, w18) -> w19
      Property Node(instance in=w15, "Bandwidth (MHz)"=w17, "SNR"=w14, "Power Consumption %"=w19, "Step Pass?"=w9) -> (instance out=w20)
      append w20 to w12
    }
    $"Test Sequence Results" <- w12
    Build Index And Bundle Cluster Array(w3, w4) -> (out=w21)
    Build Index And Bundle Cluster Array(w3, w5) -> (out=w22)
    Build Index And Bundle Cluster Array(w3, w6) -> (out=w23)
    Build Index And Bundle Cluster Array(w3, w7) -> (out=w24)
    Build Array(w21, w22, w23, w24) -> w25
    $"Observed Data and Fitted Curve" <- w25
    stop if FALSE
  }
